# Grasshopper definition SECTION_PLUGIN_EXAMPLE_FILE.gh (Grasshopper 1.0.8)
# plug-ins: SectionToolkit.Components

# ----
# Helper For Construct Names
panel = Panel("5")
name_builder = NameBuilder(Count=panel)

# ----
# Plugin Run Control
list = ValueList({"Idle": 0, "Generate": 1, "Clear": 2}, selected="Idle")
run_control = RunControl(Control=list)

# ----
# Clipping Plane Z Location in Rhino
panel_2 = Panel("100")

# ----
# Example Inputs
curve = Curve([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])
geometry = Geometry(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)

section_generator = SectionGenerator(Mode=run_control, Curves=curve, Context=geometry, Names=name_builder, Zoffset=panel_2)

# ----
# Select Unit
list_2 = ValueList({"1\" = 1'-0": 0, "3/4\" = 1'-0": 1, "1/2\" = 1'-0": 2, "3/8\" = 1'-0": 3, "1/4\" = 1'-0": 4, "3/16\" = 1'-0": 5, "1/8\" = 1'-0": 6, "1/16\" = 1'-0": 7, "1/32\" = 1'-0": 8, "1/64\" = 1'-0": 9}, selected="1/8\" = 1'-0")
list_3 = ValueList({"system": 0, "imperial": 1, "metric": 2}, selected="imperial")
unit_context = UnitContext(Unit=list_3, Index=list_2)  # -> Scale, Info

# ----
# Plugin Run Control
list_4 = ValueList({"Idle": 0, "Generate": 1, "Clear": 2}, selected="Idle")
run_control_2 = RunControl(Control=list_4)

# ----
# Sheet Settings and Generation
list_5 = ValueList({"None": 0, "Bottom Left": 1, "Bottom Center": 2, "Bottom Right": 3, "Top Left": 4, "Top Center": 5, "Top Right": 6}, selected="Bottom Left")
list_6 = ValueList({"Bottom Right": 0, "Bottom Left": 1, "Top Right": 2, "Top Left": 3}, selected="Top Right")
list_7 = ValueList({"Letter (11 x 8.5)": "{11.0, 8.5, 0}", "Tabloid (17 x 11)": "{17.0, 11.0, 0}", "Arch C (24 x 18)": "{24.0, 18.0, 0}", "Arch D (36 x 24)": "{36.0, 24.0, 0}", "Arch E1 (42 x 30)": "{42.0, 30.0, 0}", "Arch E (48 x 36)": "{48.0, 36.0, 0}"}, selected="Arch D (36 x 24)")
list_8 = ValueList({"1 Viewport": 1, "2 Viewports": 2, "3 Viewports": 3, "4 Viewports": 4}, selected="4 Viewports")
sheet_control = SheetControl(Scale=unit_context.Scale, VpCount=list_8, ShtSize=list_7, TblockPosition=list_6, VpTextPos=list_5, TblockWidth="3")
sheet_generator = SheetGenerator(Mode=run_control_2, Settings=sheet_control, Views=section_generator)  # -> Layouts, GuidsTree, ViewsTree, SettingsOut

# ----
# Key Plan Generation and Placement
list_9 = ValueList({"Idle": 0, "Generate": 1, "Clear": 2}, selected="Idle")
run_control_3 = RunControl(Control=list_9)
key_plan_generator = KeyPlanGenerator(Mode=run_control_3)
key_plan_control = KeyPlanControl(
    Mode=run_control_2,
    Layouts=sheet_generator.Layouts,
    ViewsTree=sheet_generator.ViewsTree,
    KeyPlanView=key_plan_generator,
    Settings=sheet_generator.SettingsOut,
    HeightOffset="-3")
panel_3 = Panel(key_plan_control)

# ----
# Export to PDF
list_10 = ValueList({"Idle": 0, "Generate": 1, "Clear": 2}, selected="Idle")
run_control_4 = RunControl(Control=list_10)
print_control = PrintControl(
    Mode=run_control_4,
    Layouts=sheet_generator.Layouts,
    Folder="Downloads",
    FileName="Test",
    DPI="72",
    Rasterize=Toggle(True))
panel_4 = Panel(print_control)

# ----
# Sheet Adjustment
list_11 = ValueList({"Wireframe", "Shaded", "Rendered", "Ghosted", "X-Ray", "Technical", "Monochrome", "Arctic"}, selected="Monochrome")
titleblock_control = TitleblockControl(Mode=run_control_2, Layouts=sheet_generator.Layouts, Settings=sheet_generator.SettingsOut)
display_control = DisplayControl(Mode=run_control_2, Layouts=sheet_generator.Layouts, GuidsTree=sheet_generator.GuidsTree, DispMode=list_11)
panel_5 = Panel(display_control)
panel_6 = Panel(titleblock_control)
